% Simulink data dictionary DD_Mdl1.sldd

slBus1 = Simulink.Bus()
  wind_mpers: double
  GenSpd_radpers: double
  RotSpd_radpers: double
  ydotdot_mpers2: double
  xdotdot_mpers2: double
  zetadotdot_mpers2: double
  ThetaS_rad: double
  GenPwr_kW: double
  GenTq_Nm: double
  Pitch_rad: double

slBus2 = Simulink.Bus()
  RefBlPitch1: double
  RefBlPitch2: double
  RefBlPitch3: double
  RefGenTq: double

n_h = 40
beta = [0; 0.001745329; 0.003490659; 0.005235988; 0.006981317; 0.008726646; 0.01047198; 0.0122173; 0.01396263; 0.01570796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 0.4363323]
lambda = [0; 0.1; 0.2; 0.3; 0.4; 0.5; 0.6; 0.7; 0.8; 0.9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 19.9]
rho = 1.225

Ct = [0 0 0 0 0 0 0 0 0 0 0.08296217 0.0859444 0.08898923 0.09218252 0.09547205 0.099147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
 0 0 0 0 0 0 0 0 0 0 0.08292507 0.0858965 0.08893239 0.09211563 0.09539839 0.09907465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
 0 0 0 0 0 0 0 0 0 0 0.08288701 0.08584788 0.08887387 0.09204868 0.09532177 0.09900196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
 0 0 0 0 0 0 0 0 0 0 0.08284852 0.08579822 0.08881448 0.09198163 0.09528317 0.09892982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
 0 0 0 0 0 0 0 0 0 0 0.08280999 0.0857479 0.08875488 0.09191438 0.09520931 0.0988561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
 0 0 0 0 0 0 0 0 0 0 0.08277126 0.08569671 0.08869521 0.09184644 0.09515612 0.09878253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
 0 0 0 0 0 0 0 0 0 0 0.08273247 0.08564468 0.08863495 0.0917777 0.09508159 0.09871075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
 0 0 0 0 0 0 0 0 0 0 0.08269272 0.0855223 0.08857483 0.09170892 0.09500664 0.09866092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
 0 0 0 0 0 0 0 0 0 0 0.08265194 0.08547015 0.08851378 0.09163989 0.09495906 0.09859092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
 0 0 0 0 0 0 0 0 0 0 0.08260986 0.08541792 0.08845225 0.09156891 0.09488377 0.09852131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 ]

Ce = [17786.98 0 0 0 0
 0 1246331 0 0 0
 0 0 17128.2 0 0
 0 0 0 6215000 -6215000
 0 0 0 -6215000 6215000]

Cq = [0 0 0 0 0 0 0 0 0 0 0.005237753 0.005405344 0.005584935 0.00577535 0.005993867 0.00632291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
 0 0 0 0 0 0 0 0 0 0 0.00530478 0.005474623 0.005656751 0.00585002 0.006073883 0.006414499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
 0 0 0 0 0 0 0 0 0 0 0.005371492 0.00554389 0.005728246 0.005924698 0.006153566 0.006505749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
 0 0 0 0 0 0 0 0 0 0 0.005437952 0.005612722 0.00579968 0.005999384 0.00623351 0.006597106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
 0 0 0 0 0 0 0 0 0 0 0.005504367 0.005681453 0.005871121 0.006074078 0.006314018 0.006688406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
 0 0 0 0 0 0 0 0 0 0 0.005570703 0.00574994 0.005942568 0.006148439 0.006394927 0.006779537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
 0 0 0 0 0 0 0 0 0 0 0.005637046 0.005818377 0.006013941 0.00622253 0.006476128 0.006871159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
 0 0 0 0 0 0 0 0 0 0 0.005703355 0.005887241 0.006085052 0.006296682 0.006556989 0.006964853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
 0 0 0 0 0 0 0 0 0 0 0.005769669 0.005955696 0.00615609 0.006370997 0.00663867 0.007058795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
 0 0 0 0 0 0 0 0 0 0 0.005835813 0.006024159 0.006226901 0.00644493 0.006720211 0.007153155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 ]

K5 = [1810494 0 0 0 -0
 0 5.734629e+08 0 0 -0
 0 0 1678867 0 -0
 0 0 0 867637000 -867637000
 0 0 0 -867637000 867637000]

wecsBus = Simulink.Bus()  % Bus for Wind Energy Conversion System (WECS)
  N: double
  Ng: double
  mh: double
  mbl: double
  mb: double
  mn: double
  mtower: double
  mr: double
  mt: double
  mtb: double
  H: double
  Jg: double
  Jr: double
  JrL: double
  Js: double
  wnb: double
  wnt: double
  wntsw: double
  zetat: double
  zetab: double
  Kt: double
  Bt: double
  Ktsw: double
  Btsw: double
  Kb: double
  Bb: double
  Ks: double
  Bs: double
  Rr: double
  rb: double
  etag: double
  cMx: double

M = [450170 628661.25 0 0 0
 628661.25 29704244.0625 0 0 0
 0 0 436865 0 0
 0 0 0 38759228 0
 0 0 0 0 5025497.444]

Q = [1 0 0; 47.25 0 0; 0 -0.001893236 -1.433023; 0 1 0; 0 0 -97]

wecs = struct(
  N=3,
  Ng=97,
  mh=56780,
  mbl=17740,
  mb=4435,
  mn=240000,
  mtower=347460,
  mr=110000,
  mt=436865,
  mtb=450170,
  H=90,
  Jg=534.116,
  Jr=38759228,
  JrL=38759228,
  Js=43784725.444,
  wnb=4.393831,
  wnt=2.035752,
  wntsw=1.960354,
  zetat=0.01,
  zetab=0.00477465,
  Kt=1810494,
  Bt=17786.98,
  Ktsw=1678867,
  Btsw=17128.2,
  Kb=85621.02,
  Bb=186.0838,
  Ks=867637000,
  Bs=6215000,
  Rr=63,
  rb=47.25,
  etag=0.944,
  cMx=0.8864059)

controlValue = struct(
  ForeAft=struct(Gain=0, MaxPitchAmplitude=5),
  Pitch=struct(
    Fine=0.106,
    Min=-2,
    Max=90,
    Minrate=-13,
    Maxrate=13,
    Kp=-0.003,
    Scheduled=1,
    ScheduledPitchAngles=[0.0706; 0.1168; 0.1524; 0.183; 0.2116; 0.2385; 0.263; 0.286; 0.308; 0.3284; 0.3488; 0.3691; 0.3895; 0.4083],
    KpGS=[-0.0164; -0.0107; -0.0083; -0.0068; -0.0057; -0.0049; -0.0043; -0.0037; -0.0033; -0.0028; -0.0026; -0.0023; -0.002; -0.0017],
    KiGS=[-0.0027; -0.0027; -0.0026; -0.0025; -0.0024; -0.0024; -0.0024; -0.0023; -0.0023; -0.0023; -0.0023; -0.0023; -0.0023; -0.0023],
    Ki=-0.001,
    StartupPitch=45,
    StartupPitchRate=1,
    StartupSpeed=0.25,
    Notch_beta1=0,
    Notch_beta2=0,
    Notch_wn=0,
    Notch_beta1GS=repmat(0, 14, 1),
    Notch_beta2GS=repmat(0, 14, 1),
    Notch_wnGS=repmat(0, 14, 1),
    LowPassCutOffFreq=3,
    LowPassCutOffFreqGS=repmat(3, 14, 1),
    LowPassOrder=1,
    Notch2_beta1GS=repmat(0, 14, 1),
    Notch2_beta2GS=repmat(0, 14, 1),
    Notch2_wnGS=repmat(0, 14, 1),
    Notch2_beta1=0,
    Notch2_beta2=0,
    Notch2_wn=0),
  Torque=struct(
    Demanded=43529,
    Limit=47403,
    Slewrate=20000,
    OptGain=2.3323,
    SpeedA=670,
    SpeedB=871,
    SpeedC=1162,
    SpeedB2=1136,
    Min=200,
    LowPassCutOffFreq=3),
  Brake=struct(Deploytime=0.6, Torque=28116, Delay=1.5),
  WindSpeed=struct(Cutin=4, Cutout=25),
  DT=0.008)

qLPVMPC_RefLUT = struct(
  V=[4.000002 5.000001 6.000002 7.000001 8.000001 9 10 11 12 13 14 15 16 17 18 19 20 21 22 23 24 25],
  Torque=[2.393646 5.324649 9.275124 14.10328 19.62374 24.76464 30.45676 38.20573 43.529 43.529 43.529 43.529 43.529 43.529 43.529 43.529 43.529 43.529 43.529 43.529 43.529 43.529],
  Pitch=[0.001850049 0.001850049 0.001850049 0.001850049 0.001850049 0.001850049 0.001850049 0.001850049 0.04987196 0.1038412 0.1426653 0.1754282 0.2046965 0.231624 0.2566137 0.280043 0.3023087 0.3237978 0.3446505 0.3648433 0.3843441 0.4032162],
  RSpeed=[0.7481165 0.7812295 0.8258681 0.880428 0.9456415 1.062313 1.178091 1.240277 1.254474 1.254476 1.254478 1.254478 1.254478 1.254478 1.254478 1.254478 1.254478 1.254478 1.254478 1.254478 1.254479 1.254479])